% Simulink data dictionary SEALGenericTypes_1.sldd

SEALVerControl = Simulink.Bus()
  Version: uint16  % SEAL database version
  SubVersion: uint16  % SEAL database sub version
  UserData: uint32  % SEAL database support data

SEALVerControl_init = Simulink.Parameter(struct(Version=1, SubVersion=1, UserData=0), StorageClass="ExportedGlobal", DataType="Bus: SEALVerControl")
G_SEALVerControl = Simulink.Signal(StorageClass="ExportedGlobal", DataType="Bus: SEALVerControl")

UartCyclicBuf = Simulink.Bus()
  PutCounter: uint16  % The place in the UARTQueue where next character is to be put
  FetchCounter: uint16  % The location in the UARTQueue of the next character to read
  UartError: uint16  % UART error
  TxFetchCounter: uint16  % The location in the TX UARTQueue of the next character to read
  UARTQueue: uint16[1 256]  % Software Queue for incoming UART characters

G_UartCyclicBuf_in = Simulink.Signal(StorageClass="ImportedExtern", DataType="Bus: UartCyclicBuf")
G_UartCyclicBuf_out = Simulink.Signal(StorageClass="ImportedExtern", DataType="Bus: UartCyclicBuf")

CANCyclicBuf = Simulink.Bus()
  PutCounter: uint16  % The place in the CANQueue where the next message is to be put
  FetchCounter: uint16  % The location in the CANQueue of the next message to read
  CANError: uint16  % CAN error
  CANQueue: uint32[128 2]  % Software Queue for incoming CAN messages
  TxFetchCounter: uint16  % The location in the CANQueue of the next message to transmit
  CANID: uint32[64 1]  % Can ID, 11 or 29bit
  DLenAndAttrib: uint16[64 1]  % Data length and attributes

G_CANCyclicBuf_in = Simulink.Signal(StorageClass="ImportedExtern", DataType="Bus: CANCyclicBuf")
G_CANCyclicBuf_out = Simulink.Signal(StorageClass="ImportedExtern", DataType="Bus: CANCyclicBuf")

PosProfilerData = Simulink.Bus()
  PositionTarget: single  % Final position to arrive
  ProfileSpeed: single  % Maximum speed
  ProfileAcceleration: single  % Maximum Profile acceleration
  ProfileDeceleration: single  % Maximum Profile deceleration
  ProfileFilterDen: double[4 1]  % Filter monic polynomial for profile filtering
  ProfileFilterNum: double  % Filter numerator for profile filtering
  ProfileDataOk: uint16  % Flag that profiler data is consistent

PosProfilerState = Simulink.Bus()
  Position: double  % Position state of profiler
  Speed: double  % Speed state of profiler
  FiltState: double[8 1]  % State of profiling filter

SystemData = Simulink.Bus()
  Ts: single  % Profiler sampling time
  MaxPosition: single  % Maximum position
  MinPosition: single  % Minimum position
  AbsSpeedLimit: single  % Absolute Speed limit
  AbsAccelerationLimit: single  % Absolute Acceleration limit
  CurrentCommandLimit: single  % Current command limit

DrvCommandBuf = Simulink.Bus()
  PositionCommand: double  % Command to position controller
  SpeedCommand: double  % Command to speed controller
  CurrentCommand: double  % Command to current controller
  LoopConfiguration: int16  % Control loop configuration
  ReferenceMode: int16  % ReferenceMode
  MotorOn: int16  % Motor on request
  FailureReset: int16  % Failure Reset Request
  Spare_8: int32  % Spare : 8
  Spare_9: int32  % Spare : 9
  Spare_10: int32  % Spare : 10
  Spare_11: int32  % Spare : 11
  Spare_12: int32  % Spare : 12
  Spare_13: int32  % Spare : 13
  Spare_14: int32  % Spare : 14
  Spare_15: int32  % Spare : 15
  Spare_16: int32  % Spare : 16
  Spare_17: int32  % Spare : 17
  Spare_18: int32  % Spare : 18
  Spare_19: int32  % Spare : 19
  Spare_20: int32  % Spare : 20
  Spare_21: int32  % Spare : 21
  Spare_22: int32  % Spare : 22
  Spare_23: int32  % Spare : 23
  Spare_24: int32  % Spare : 24

FeedbackBuf = Simulink.Bus()
  EncoderMain: int32  % The main encoder sensor
  EncoderSecondary: int32  % The secondary encoder sensor
  EncoderMainSpeed: single  % Speed of main encoder sensor
  EncoderSecondarySpeed: single  % Speed of secondary encoder sensor
  Iq: single  % Q-channel current Amp
  Id: single  % Q-channel current Amp
  DcBusVoltage: single  % DC bus voltage V
  PowerStageTemperature: single  % Power stage temperature C
  FieldAngle: single  % Motor electrical field angle
  Spare_10: int32  % Spare : 10
  Spare_11: int32  % Spare : 11
  Spare_12: int32  % Spare : 12
  LoopConfiguration: int16  % Control loop configuration
  ReferenceMode: int16  % ReferenceMode
  MotorOn: int16  % Motor on report
  HallCode: int16  % Code of Hall sensors
  STODisable: int16  % 1 if disabled by STO
  StatusBitField: int16  % Status bit field
  ErrorCode: uint32  % Motor failure report
  Spare_20: int32  % Spare : 20
  Spare_21: int32  % Spare : 21
  Spare_22: int32  % Spare : 22
  Spare_23: int32  % Spare : 23
  Spare_24: int32  % Spare : 24

SetupReportBuf = Simulink.Bus()
  EncoderMain: int32  % The main encoder sensor
  EncoderSecondary: int32  % The secondary encoder sensor
  EncoderMainSpeed: single  % Speed of main encoder sensor
  EncoderSecondarySpeed: single  % Speed of secondary encoder sensor
  Iq: single  % Q-channel current Amp
  Id: single  % Q-channel current Amp
  DcBusVoltage: single  % DC bus voltage V
  PowerStageTemperature: single  % Power stage temperature C
  FieldAngle: single  % Motor electrical field angle
  Spare_10: int32  % Spare : 10
  Spare_11: int32  % Spare : 11
  Spare_12: int32  % Spare : 12
  LoopConfiguration: int16  % Control loop configuration
  ReferenceMode: int16  % ReferenceMode
  MotorOn: int16  % Motor on report
  HallCode: int16  % Code of Hall sensors
  STODisable: int16  % 1 if disabled by STO
  StatusBitField: int16  % Status bit field
  ErrorCode: uint32  % Motor failure report
  Spare_20: int32  % Spare : 20
  Spare_21: int32  % Spare : 21
  Spare_22: int32  % Spare : 22
  Spare_23: int32  % Spare : 23
  Spare_24: int32  % Spare : 24

SystemData_init = Simulink.Parameter(struct(
  Ts=single(0.01),
  MaxPosition=single(1.0e+18),
  MinPosition=single(-1.0e+18),
  AbsSpeedLimit=single(1.0e+18),
  AbsAccelerationLimit=1000000,
  CurrentCommandLimit=20), StorageClass="ExportedGlobal", DataType="Bus: SystemData")

PosProfilerData_init = Simulink.Parameter(struct(
  PositionTarget=0,
  ProfileSpeed=1,
  ProfileAcceleration=1,
  ProfileDeceleration=1,
  ProfileFilterDen=[1; -0.8740523; 0.2808403; -0.02447752],
  ProfileFilterNum=0.3823105,
  ProfileDataOk=0), StorageClass="ExportedGlobal", DataType="Bus: PosProfilerData")

PosProfilerState_init = Simulink.Parameter(struct(Position=0, Speed=0, FiltState=repmat(0, 8, 1)), StorageClass="ExportedGlobal", DataType="Bus: PosProfilerState")
G_DrvCommandBuf = Simulink.Signal(StorageClass="ImportedExtern", DataType="Bus: DrvCommandBuf")
G_FeedbackBuf = Simulink.Signal(StorageClass="ImportedExtern", DataType="Bus: FeedbackBuf")
G_SetupReportBuf = Simulink.Signal(StorageClass="ImportedExtern", DataType="Bus: SetupReportBuf")